# Dynamo graph Graph.dyn (Dynamo 2.5.2.7915)

# group: License
# note: GNU License
# This program is free software: you can redistribute it and/or modify it under the terms of the GNU General Public License as published by the Free Software Foundation, either version 3 of the License, or (at your option) any later version.
# This program is distributed in the hope that it will be useful, but WITHOUT ANY WARRANTY; without even the implied warranty of MERCHANTABILITY or FITNESS FOR A PARTICULAR PURPOSE. See the GNU General Public License for more details.
# You should have received a copy of the GNU General Public License along with this program. If not, see http://www.gnu.org/licenses/

# group: Collect the doors and get their locations to group/sort by
family_types = FamilyTypes("Door-Single-Panel:36\" x 84\"")
all_elements_of_family_type = ElementsOfFamilyType(Family_Type=family_types)
getLocation = Element.GetLocation(element=all_elements_of_family_type)

# group: Does all the sorting and grouping of doors since the collector sorts by element id by default
X = Point.X(point=getLocation)
round = Math.Round(number=X)
groupByKey = List.GroupByKey(list=all_elements_of_family_type, keys=round)
sortByKey = List.SortByKey(list=groupByKey.groups, keys=groupByKey.unique_keys)
getLocation_2 = Element.GetLocation(element=sortByKey.sorted_list)
Y = Point.Y(point=getLocation_2)
round_2 = Math.Round(number=Y)
sortByKey_2 = List.SortByKey(list=sortByKey.sorted_list@L2, keys=round_2@L2)

# group: How many points in each direction?
points_each_direction_smaller = IntegerSlider(100, range=10..100 step 10)  # "Points Each Direction (smaller = faster)"

takeItems = List.TakeItems(list=sortByKey_2.sorted_list@L2, amount=points_each_direction_smaller)

# group: Your source image. Preferred to be square
file_path = Filename(".\2020-03-17_9-38-21.png")

# group: Read the source image
file_from_path = FileObject(path=file_path)
readFromFile = Image.ReadFromFile(file=file_from_path)
pixels = Image.Pixels(image=readFromFile, xSamples=points_each_direction_smaller, ySamples=points_each_direction_smaller)

# group: Calculate brightness for swing angle setting
brightness = Color.Brightness(c=pixels)
code_block = CodeBlock { 90; 0; }
remapRange = Math.RemapRange(numbers=brightness, newMin=code_block.out0, newMax=code_block.out1)

# group: Set the swings
code_block_2 = CodeBlock { "Swing Angle"; }
setParameterByName = Element.SetParameterByName(element=takeItems, parameterName=code_block_2, value=remapRange)

# group: Purely to preview in Dynamo
getLocation_3 = Element.GetLocation(element=takeItems)
byGeometryColor = Modifiers.GeometryColor.ByGeometryColor(geometry=getLocation_3, color=pixels)
