# Dynamo graph PathOfTravel_PointToExteriorDoors.dyn "pathCalcs" (Dynamo 2.3.0.5885)
# packages: archi-lab.net 2020.22.7

# group: Point to start at
select_point_on_face = DSPointOnElementSelection()  # 1 picked in the model

# group: Level to mess with
levels = Levels("01 - Entry Level")

# group: This sections collects all of the doors that are on a chosen level and hosted in an "Exterior" wall. Probably other ways to do this too.
code_block = CodeBlock { "Doors"; }
byName = Category.ByName(name=code_block)
byCategoryAndLevel = archilab.Revit.Selection.Select.ByCategoryAndLevel(category=byName, level=levels)
getHost = FamilyInstance.GetHost(familyInstance=byCategoryAndLevel)
elementType = Element.ElementType(element=getHost)
code_block_2 = CodeBlock { "Function"; 1; }
getParameterValueByName = Element.GetParameterValueByName(element=elementType, parameterName=code_block_2.out0)
eq = getParameterValueByName == code_block_2.out1
filterByBoolMask = List.FilterByBoolMask(list=byCategoryAndLevel, mask=eq)

# group: Gets a location point for the doors. This offers a clumsier, but more consistent location (curtain wall doors suck).
geometry = Element.Geometry(element=filterByBoolMask.in)
byGeometry = BoundingBox.ByGeometry(geom=geometry)
toCuboid = BoundingBox.ToCuboid(boundingBox=byGeometry)
centroid = Solid.Centroid(solid=toCuboid)

# group: The magic. This generates paths and returns them with the length parameter. we then sort by that length
firstItem = List.FirstItem(list=select_point_on_face)
python_script = Python(IN[0]=firstItem, IN[1]=centroid)
# ---------- python_script.python (37 lines) ----------
import clr

clr.AddReference('RevitAPI')
from Autodesk.Revit.DB.Analysis import *

# import Dynamo Revit nodes and converters
clr.AddReference('RevitNodes')
import Revit
clr.ImportExtensions(Revit.GeometryConversion)

# import Transaction methods and Document helpers
clr.AddReference('RevitServices')
import RevitServices
from RevitServices.Persistence import DocumentManager
from RevitServices.Transactions import TransactionManager

# access to the active document and active ui document
doc = DocumentManager.Instance.CurrentDBDocument
uidoc=DocumentManager.Instance.CurrentUIApplication.ActiveUIDocument

#Preparing input from dynamo to revit
firstPoint = IN[0].ToXyz()
roomPoints = IN[1]
lengths = []
paths = []
#Do some action in a Transaction
TransactionManager.Instance.EnsureInTransaction(doc)
for point in roomPoints:
	#generate a path of travel temporarily for length calculation
	pot = PathOfTravel.Create(doc.ActiveView,firstPoint,point.ToXyz())
	lengths.append(pot.LookupParameter("Length").AsDouble())
	paths.append(pot)
	#doc.Delete(pot.Id) # discard the temp path of travel
	
TransactionManager.Instance.TransactionTaskDone()

OUT = paths,lengths
# ----------------------------------------
code_block_3 = CodeBlock(output=python_script) { pathOfTravel = output[0]; lengths = output[1]; }
sortByKey = List.SortByKey(list=code_block_3.pathOfTravel, keys=code_block_3.lengths)
