# Dynamo graph GetAllWallsOfType.dyn (Dynamo 3.0.3.7597)

# group: Collect All Walls
categories_ᶜᵒⁿᵛᵉʳᵗᵉᵈ_ᵈʳᵒᵖᵈᵒʷⁿ = CodeBlock()
# ---------- categories_ᶜᵒⁿᵛᵉʳᵗᵉᵈ_ᵈʳᵒᵖᵈᵒʷⁿ.designscript (2 lines) ----------
//Walls;
Revit.Elements.Category.ById(-2000011);
# ----------------------------------------
all_elements_of_category = ElementsOfCategory(Category=categories_ᶜᵒⁿᵛᵉʳᵗᵉᵈ_ᵈʳᵒᵖᵈᵒʷⁿ)

# group: Get WallType and ID
elementType = Element.ElementType(element=all_elements_of_category)
id = Element.Id(element=elementType)

# group: Select a WallType to Search For
wall_types = WallTypes("Chase - GWB & Metal Stud 3 1/8\"")
id_2 = Element.Id(element=wall_types)

# group: Check if the wall's type id is equal to target
eq = id == id_2

# group: Filter for Walls that Equal Type
filterByBoolMask = List.FilterByBoolMask(list=all_elements_of_category, mask=eq)

# group: These are the Walls of that Type
walls_of_type = Watch(filterByBoolMask.in)

# note: Total walls in model
count = List.Count(list=all_elements_of_category)
