# Dynamo graph viewActivationCount.dyn (Dynamo 2.6.0.8481)
# packages: Journalysis for Dynamo 2.x 2.3.1, NodeModelCharts 2.0.2

# group: Input
file_path = Filename("C:\Users\johnpierson\AppData\Local\Autodesk\Revit\Autodesk Revit 2021\Journals\journal.0891.txt")
# note: Custom Package: Journalysis v.2.3.1
byPath = Custom[Journal.ByPath](path=file_path)  # package Journalysis for Dynamo 2.x; Creates a queryable object from the contents of a Revit journal file

# group: Read the Journal UI Event Lines
code_block = CodeBlock { "JournalUIEvent"; }
# note: Custom Package: Journalysis v.2.3.1
linesByType = Custom[Journal.LinesByType](journal=byPath, journalLineType=code_block)  # package Journalysis for Dynamo 2.x; Retrieves all JournalLines of a given type from a given journal

# group: Filter out the view activated lines
# note: Custom Package: Journalysis v.2.3.1
type = Custom[JournalUIEvent.Type](journalUIEvent=linesByType)  # package Journalysis for Dynamo 2.x; Returns the type of a UIEvent line
code_block_2 = CodeBlock { "Activate"; }
eq = type == code_block_2
filterByBoolMask = List.FilterByBoolMask(list=linesByType, mask=eq)

# group: Obtain the Revit Model Name and View Name that was activated
# note: Custom Package: Journalysis v.2.3.1
data = Custom[JournalUIEvent.Data](journalUIEvent=filterByBoolMask.in)  # package Journalysis for Dynamo 2.x; Returns the data from a UIEvent line

# group: Get the view names
code_block_3 = CodeBlock { 1; }
getItemAtIndex = List.GetItemAtIndex(list=data@L2, index=code_block_3)

# group: All the Dataz
groupByKey = List.GroupByKey(list=getItemAtIndex, keys=getItemAtIndex)
# note: Activation Counts
count = List.Count(list=groupByKey.groups@L2)
code_block_4 = CodeBlock(unique=groupByKey.unique_keys) { 0..1..#DSCore.List.Count(unique); }
color_range = ColorRange(value=code_block_4)  # unwired: colors, indices
# note: Custom Package: NodeModelCharts v.2.0.2
pie_chart = PieChartNodeModel(labels=groupByKey.unique_keys, values=count, colors=color_range, Labels=["Floor Plan: 02 - Floor", "Floor Plan: 01 - Entry Level - Furniture Layout", "Floor Plan: 01 - Entry Level"], Values=[2, 2, 1], Colors=["#FFFF6464", "#FFFFFF00", "#FF00FFFF"])
