# Dynamo graph WindowToWallRatio.dyn (Dynamo 2.6.1.8786)
# packages: Rhythm 2021.1.1, Clockwork for Dynamo 2.x 2.3.0

categories = Categories("OST_Walls")
all_elements_of_category = ElementsOfCategory(Category=categories)
elementType = Element.ElementType(element=all_elements_of_category)
kind = WallType.Kind(wallType=elementType)
code_block = CodeBlock { "Basic"; }
eq = kind == code_block
filterByBoolMask = List.FilterByBoolMask(list=all_elements_of_category, mask=eq)
ʳʰʸᵗʰᵐ_walls_direction = Rhythm.Revit.Elements.Walls.Direction(wall=filterByBoolMask.in)
groupByKey = List.GroupByKey(list=filterByBoolMask.in, keys=ʳʰʸᵗʰᵐ_walls_direction.facingDirection)
code_block_2 = CodeBlock { 1; }
inserts = Custom[Element.Inserts](element=groupByKey.groups, includeEmbeddedWalls=code_block_2)  # package Clockwork for Dynamo 2.x; Gets all the objects inserted into a given element.
