# Dynamo graph PropabilityOfUse.dyn (Dynamo 2.5.0.7460)
# packages: Dynamo Text 2.0.1

string = StringInput("NO")
code_block = CodeBlock { 10; }
cycle = List.Cycle(list=string, amount=code_block)
integer_slider = IntegerSlider(4, range=0..10 step 1)  # graph input
getItemAtIndex = List.GetItemAtIndex(list=cycle, index=integer_slider)
origin = Point.Origin()
watch = Watch(integer_slider)  # graph output
fromStringOriginAndScale = DynamoText.Text.FromStringOriginAndScale(text=getItemAtIndex, origin=origin, scale=watch)
byCurve = ModelCurve.ByCurve(curve=fromStringOriginAndScale)
