# Dynamo graph LBML_NeuralNetwork_RoomNamePrediction.dyn "LBML_NeuralNetwork_Sample" (Dynamo 2.0.3.8810)
# Provided by ParallaxTeam under the CC BY-SA 4.0 license

# group: Info
# note: NOTE: Currently this uses bounding box to approximate width and depth of rooms. In Revit, bounding boxes are axis aligned meaning that if your building is angled the width and depth will not be accurate. The goal is to fix this in the future.

# group: Annotation
# note: For notes and titles

# group: Info
# note: For general Information

# group: Other
# note: For general other needs

# group: To Revit
# note: For changes made to Revit

# group: Control
# note: For sliders and other options

# group: Input
# note: For selection and whatnot

# group: Background
# note: For workflow

# group: Info:
# note: This graph will predict the room name for a newly placed room from a selected set of rooms to use as training data. Upon run, you will be asked to select rooms to use as training data.
# This graph can be ran on the Revit Advanced Sample Model or any other model with actual room elements already placed.

# group: Packages Req'd
# note: LunchBoxML

# group: Credits:
# note: Sample graph created by John Pierson (@60secondrevit) of Parallax Team (parallaxteam.com).

# group: Newly placed room and training data refresh
select_newly_placed_room = DSModelElementSelection()  # 1 picked in the model
refresh_training_data_selection = BoolSelector(true)

# group: Collects all rooms for training data. (Also removes the newly placed one)
code_block = CodeBlock { "Rooms"; }
python_script = Python(IN[0]=refresh_training_data_selection, IN[1]=code_block)
# ---------- python_script.python (39 lines) ----------
import clr

clr.AddReference("RevitAPIUI")
from  Autodesk.Revit.UI import *

clr.AddReference("RevitServices")
import RevitServices
from RevitServices.Persistence import DocumentManager
doc = DocumentManager.Instance.CurrentDBDocument
uidoc=DocumentManager.Instance.CurrentUIApplication.ActiveUIDocument

clr.AddReference("RevitNodes")
import Revit
clr.ImportExtensions(Revit.Elements)
TaskDialog.Show('Isolated Selection','Pick the rooms you want to use as training data. Avoid selecting the new room if possible.')

sel1 = uidoc.Selection
obt1 = Selection.ObjectType.Element
class CustomISelectionFilter(Selection.ISelectionFilter):
	def __init__(self, nom_categorie):
		self.nom_categorie = nom_categorie
	def AllowElement(self, e):
		if e.Category.Name == self.nom_categorie:
			return True
		else:
			return False
	def AllowReference(self, ref, point):
		return true
		
el_ref = sel1.PickObjects(obt1, CustomISelectionFilter(IN[1]))
elementList = list()
for i in el_ref:
	
	try:
		elementList.append(doc.GetElement(i.ElementId))
	except:
		elementList.apped(list())
		
OUT = elementList
# ----------------------------------------
setDifference = List.SetDifference(list1=python_script, list2=select_newly_placed_room)

# group: Re-Join the list to only collect data once
join = List.Join(list0=select_newly_placed_room, list1=setDifference)

# group: Generate labels and get room names
name = Room.Name(room=join)
code_block_2 = CodeBlock(rooms=join) { 0..DSCore.List.Count(rooms); }

# group: Area and perimeter for training data
area = Room.Area(room=join)
code_block_3 = CodeBlock { "Perimeter"; }
getParameterValueByName = Element.GetParameterValueByName(element=join, parameterName=code_block_3)

# group: Room bounding box to derive width and depth
boundingBox = Element.BoundingBox(element=join)
maxPoint = BoundingBox.MaxPoint(boundingBox=boundingBox)
minPoint = BoundingBox.MinPoint(boundingBox=boundingBox)

# group: Derived Width
X = Point.X(point=maxPoint)
X_2 = Point.X(point=minPoint)
sub = X - X_2

# group: Derived Depth
Y = Point.Y(point=maxPoint)
Y_2 = Point.Y(point=minPoint)
sub_2 = Y - Y_2

# group: Training Data Remapped between 0 and 1
# note: I am padding this data with a 0 and a large value so my min and max will vary a bit more. (There is probably a better way to do this.)
code_block_4 = CodeBlock(area=area) { 0; DSCore.List.MaximumItem(area) + 1; }
list_create = List.Create(item0=area, item1=getParameterValueByName, item2=sub, item3=sub_2)
transpose = List.Transpose(lists=list_create)
addItemToEnd = List.AddItemToEnd(item=code_block_4.out1, list=transpose@L2)
addItemToFront = List.AddItemToFront(item=code_block_4.out0, list=addItemToEnd@L2)
code_block_5 = CodeBlock { 0; 1; }
remapRange = Math.RemapRange(numbers=addItemToFront, newMin=code_block_5.out0, newMax=code_block_5.out1)

deconstruct = List.Deconstruct(list=remapRange)

# group: Lunchbox ML Nodes
code_block_6 = CodeBlock(testData=deconstruct.first)
# ---------- code_block_6.designscript (2 lines) ----------
//re-nest the list
[testData];
# ----------------------------------------
code_block_7 = CodeBlock { 5; 2; }
integer_slider = IntegerSlider(10, range=0..100 step 1)
code_block_8 = CodeBlock { 5; }
# note: Custom Node: LunchBoxML
neuralNetwork = MachineLearning.Networks.NeuralNetwork(TestData=code_block_6, TrainingData=deconstruct.rest, LabelList=code_block_2, HiddenNeurons=code_block_7.out0, alpha=code_block_7.out1, iterations=integer_slider, seed=code_block_8)

# group: Get the likely name
toNumber = String.ToNumber(str=neuralNetwork)
getItemAtIndex = List.GetItemAtIndex(list=name, index=toNumber)

# group: Set it in Revit
code_block_9 = CodeBlock { "Name"; }
setParameterByName = Element.SetParameterByName(element=select_newly_placed_room, parameterName=code_block_9, value=getItemAtIndex)

# group: License:
# note: Provided under the Creative Commons-ShareAlike 4.0 license
cc_by_sa_4_0 = StringInput("https://creativecommons.org/licenses/by-sa/4.0/")
