# Dynamo graph TablesTooClose.dyn (Dynamo 2.5.0.7460)
# packages: spring nodes 203.2.0, Rhythm 2020.2.13, Clockwork for Dynamo 2.x 2.3.0

# group: Only pick furniture
code_block = CodeBlock { "Furniture"; }
isolated_pick_model_elements = Custom[Isolated Pick Model Elements](category=code_block)  # package Rhythm; This allows a multiple selection of elements of specified category.

# group: This disables furniture from the path finding temporarily
python_script = Python()  # unwired: IN[0]
# ---------- python_script.python (35 lines) ----------
import clr

clr.AddReference('RevitAPI')
from Autodesk.Revit.DB.Analysis import *
from Autodesk.Revit.DB import *

# import Dynamo Revit nodes and converters
clr.AddReference('RevitNodes')
import Revit
clr.ImportExtensions(Revit.GeometryConversion)

# import Transaction methods and Document helpers
clr.AddReference('RevitServices')
import RevitServices
from RevitServices.Persistence import DocumentManager
from RevitServices.Transactions import TransactionManager

# access to the active document and active ui document
doc = DocumentManager.Instance.CurrentDBDocument
uidoc=DocumentManager.Instance.CurrentUIApplication.ActiveUIDocument

#Preparing input from dynamo to revit
run = IN[0] 

#store the original settings
set = RouteAnalysisSettings.GetRouteAnalysisSettings(doc)
ignoredCategoriesOriginal = set.GetIgnoredCategoryIds()
newCats = ignoredCategoriesOriginal
newCats.Add(ElementId(-2000080))
#Do some action in a Transaction
TransactionManager.Instance.EnsureInTransaction(doc)
set.SetIgnoredCategoryIds(newCats)	
TransactionManager.Instance.TransactionTaskDone()

OUT = ignoredCategoriesOriginal
# ----------------------------------------

# group: Generate lots of Path Of Travel Lines
passthrough = Custom[Passthrough](passThrough=isolated_pick_model_elements, waitFor=python_script)  # package Clockwork for Dynamo 2.x; Forces a sequential order of execution. The node wired into the output of the Passthrough node will be executed *after* the node wired into the waitFor input (e.g. important for some Revit operations). The value of the passThrough input will be passed on to the node wired into the output port of the Passthrough node.
ꟿ_document_activeview = Custom[ꟿ Document.ActiveView]()  # package spring nodes; Selects the current document's active view. Supports more view types than the built-in option. Will be depreciated once the bult in node works with all plan types.
code_block_2 = CodeBlock(x=ꟿ_document_activeview) { x; }
getLocation = Element.GetLocation(element=passthrough)
boolean = BoolSelector(false)
byFloorPlanPoints = PathOfTravel.ByFloorPlanPoints(floorPlan=code_block_2, startPtList=getLocation, endPtList=getLocation, manyToMany=boolean, lacing=CrossProduct)

# group: if this errors it is ok. it is because of a null path of travel
code_block_3 = CodeBlock { "Length"; }
getParameterValueByName = Element.GetParameterValueByName(element=byFloorPlanPoints, parameterName=code_block_3)

# group: Your distancing between objects (change for your project units)
number_from_feet_and_inches = LengthFromString(Value=1.8288)  # graph input
convert_between_units = DynamoConvert(number_from_feet_and_inches, MeasurementType="Length", FromConversion="Feet", ToConversion="Millimeters")

# group: Background
lt = getParameterValueByName < convert_between_units
code_block_4 = CodeBlock { false; }
isNull = Object.IsNull()  # unwired: obj
replaceByCondition = Replace(item=lt, replaceWith=code_block_4, condition=isNull)

# group: out = furniture that is too close
allFalse = List.AllFalse(list=replaceByCondition@L2)
filterByBoolMask = List.FilterByBoolMask(list=passthrough, mask=allFalse)

# group: Reset the path of travel settings to what they were before run
code_block_5 = CodeBlock { true; }
passthrough_2 = Custom[Passthrough](passThrough=code_block_5, waitFor=filterByBoolMask.out)
python_script_2 = Python(IN[0]=passthrough_2, IN[1]=python_script)
# ---------- python_script_2.python (37 lines) ----------
import clr

clr.AddReference('RevitAPI')
from Autodesk.Revit.DB.Analysis import *
from Autodesk.Revit.DB import *

# import Dynamo Revit nodes and converters
clr.AddReference('RevitNodes')
import Revit
clr.ImportExtensions(Revit.GeometryConversion)

# import Transaction methods and Document helpers
clr.AddReference('RevitServices')
import RevitServices
from RevitServices.Persistence import DocumentManager
from RevitServices.Transactions import TransactionManager
clr.AddReference('System')
from System.Collections.Generic import List

# access to the active document and active ui document
doc = DocumentManager.Instance.CurrentDBDocument
uidoc=DocumentManager.Instance.CurrentUIApplication.ActiveUIDocument

#Preparing input from dynamo to revit
runIt = IN[0]
oldCats = List[ElementId](IN[1])

#store the original settings
set = RouteAnalysisSettings.GetRouteAnalysisSettings(doc)

#Do some action in a Transaction
if runIt == True:
	TransactionManager.Instance.EnsureInTransaction(doc)
	set.SetIgnoredCategoryIds(oldCats)	
	TransactionManager.Instance.TransactionTaskDone()

OUT = []
# ----------------------------------------

# group: Input
delete_path_of_travel_lines = BoolSelector(true)  # graph input

# group: Optionally delete the Path of Travel Lines
passthrough_3 = Custom[Passthrough](passThrough=byFloorPlanPoints, waitFor=passthrough_2)
ʳʰʸᵗʰᵐ_helpers_toggle = Rhythm.Helpers.Helpers.Toggle(obj=passthrough_3, toggle=delete_path_of_travel_lines)
delete = Element.Delete(element=ʳʰʸᵗʰᵐ_helpers_toggle)

# group: OVerride furniture that is too close
furniture_too_close = Watch(filterByBoolMask.out)
color_palette = ColorPalette({R: 255, G: 0, B: 0, A: 255})
byProperties = Revit.Filter.OverrideGraphicSettings.ByProperties(cutFillColor=color_palette, projectionFillColor=color_palette, cutLineColor=color_palette, projectionLineColor=color_palette)
overrideInView = Element.OverrideInView(element=furniture_too_close, overrides=byProperties)

# group: Reset furniture overrides if it is ok
byProperties_2 = Revit.Filter.OverrideGraphicSettings.ByProperties()
overrideInView_2 = Element.OverrideInView(element=filterByBoolMask.in, overrides=byProperties_2)
