# Dynamo graph randomizeGrid.dyn (Dynamo 2.5.0.7460)
# packages: GenerativeDesign 1.0.1, Rhythm 2020.6.22, LunchBox for Dynamo 2018.7.6

select_wall_element = DSModelWallSelection()  # 1 picked in the model; graph input
ʳʰʸᵗʰᵐ_curtaingrid_bywallelement = Rhythm.Revit.Elements.CurtainGrid.ByWallElement(curtainWall=select_wall_element)
ʳʰʸᵗʰᵐ_curtaingridline = Rhythm.Revit.Elements.CurtainGridLine.AllSegmentCurves(curtainGridLine=ʳʰʸᵗʰᵐ_curtaingrid_bywallelement.vGrids)
explode = Geometry.Explode(geometry=ʳʰʸᵗʰᵐ_curtaingridline)
seed = IntegerSlider(0, range=0..100 step 1)  # graph input
code_block = CodeBlock(list=ʳʰʸᵗʰᵐ_curtaingridline, start=seed) { count = DSCore.List.Count(list); start..count + start-1; }
randomizeOrder = Lists.Manage.RandomizeOrder(Data=explode, Seed=code_block.out1)
code_block_2 = CodeBlock { 3; }
takeItems = List.TakeItems(list=randomizeOrder.Randomized@L2, amount=code_block_2)
remove_segments = BoolSelector(true)
ʳʰʸᵗʰᵐ_helpers_toggle = Rhythm.Helpers.Helpers.Toggle(obj=takeItems, toggle=remove_segments)
ʳʰʸᵗʰᵐ_curtaingridline_2 = Rhythm.Revit.Elements.CurtainGridLine.RemoveSegment(curtainGridLine=ʳʰʸᵗʰᵐ_curtaingrid_bywallelement.vGrids, curves=ʳʰʸᵗʰᵐ_helpers_toggle)
flatten = List.Flatten(list=takeItems)
removed_count = List.Count(list=flatten)  # graph output
