# Dynamo graph SightlineAnalysisWithViewCone.dyn (Dynamo 2.12.0.5650)
# packages: spring nodes 204.1.0, Clockwork for Dynamo 2.x 2.3.0, SpaceAnalysis 0.3.3

# group: Input
# note: For selection and whatnot

# group: Background
# note: For workflow

# group: Control
# note: For sliders and other options

# group: To Revit
# note: For changes made to Revit

# group: Annotation
# note: For notes and titles

# group: Info
# note: For general Information

# group: Other
# note: For general other needs

# group: License
# note: GNU License
# This program is free software: you can redistribute it and/or modify it under the terms of the GNU General Public License as published by the Free Software Foundation, either version 3 of the License, or (at your option) any later version.
# This program is distributed in the hope that it will be useful, but WITHOUT ANY WARRANTY; without even the implied warranty of MERCHANTABILITY or FITNESS FOR A PARTICULAR PURPOSE. See the GNU General Public License for more details.
# You should have received a copy of the GNU General Public License along with this program. If not, see http://www.gnu.org/licenses/

# group: Packages Required
# note: spring nodes
# Clockwork
# SpaceAnalysis

# group: Select entourage and get the location data for it
select_model_element = DSModelElementSelection()  # 1 picked in the model
geometry = Element.Geometry(element=select_model_element)
getLocation = Element.GetLocation(element=select_model_element)
facingOrientation = FamilyInstance.FacingOrientation(familyInstance=select_model_element)

# group: Collect all the rooms in the active view
# note: Custom Package: spring nodes
ꟿ_document_activeview = Custom[ꟿ Document.ActiveView]()  # package spring nodes; Selects the current document's active view. Supports more view types than the built-in option. Will be depreciated once the bult in node works with all plan types.
categories = Categories("OST_Rooms")
ꟿ_collect_elementsinview = Custom[ꟿ Collect.ElementsInView](view=ꟿ_document_activeview, category=categories)  # package spring nodes; Selects all elements visible in the input view.
flatten = List.Flatten(list=ꟿ_collect_elementsinview)

# group: Get door bounding boxes to trim from room boundaries
# note: Custom Package: Clockwork
doors = Custom[Room.Doors](room=flatten)  # package Clockwork for Dynamo 2.x; Retrieves all doors that are associated with a room (hosted in walls and roofs).
# note: Errors right here are ignorable
boundingBox = Element.BoundingBox(element=doors)
code_block = CodeBlock { false; }
clean = List.Clean(list=boundingBox, preserveIndices=code_block)
toCuboid = BoundingBox.ToCuboid(boundingBox=clean)

# group: Trim doors from solid
solids = Element.Solids(element=flatten)
byUnion = Solid.ByUnion(solids=solids)
differenceAll = Solid.DifferenceAll(solid=byUnion, others=toCuboid)

# group: Get room outer boundary for door calculations
finishBoundary = Room.FinishBoundary(room=flatten)
deconstruct = List.Deconstruct(list=finishBoundary@L3)
byJoinedCurves = PolyCurve.ByJoinedCurves(curves=deconstruct.first)

# group: Get curves without doors
intersect = Geometry.Intersect(geometry=differenceAll, other=byJoinedCurves)
list_create = List.Create(item0=intersect, item1=deconstruct.rest)

# group: Reconstruct as simple lines. (Required for space analysis)
flatten_2 = List.Flatten(list=list_create)
code_block_2 = CodeBlock { 0..1..#10; }
pointAtParameter = Curve.PointAtParameter(curve=flatten_2, param=code_block_2, lacing=CrossProduct)
byPoints = PolyCurve.ByPoints(points=pointAtParameter)
curves = PolyCurve.Curves(polyCurve=byPoints)
flatten_3 = List.Flatten(list=curves)

# group: Build the space lattice
byGeometry = BoundingBox.ByGeometry(geom=flatten_3)
code_block_3 = CodeBlock { 300; }
# note: Custom Package: SpaceAnalysis
byBoundingBoxAndLines = Core.SpaceLattice.ByBoundingBoxAndLines(boundingBox=byGeometry, barriers=flatten_3, resolution=code_block_3)

code_block_4 = CodeBlock { 130; }

# group: Generate a visibility grid
# note: Custom Package: SpaceAnalysis
byViewPointAndViewDirection = Visibility.ViewCone.ByViewPointAndViewDirection(viewPoint=getLocation, viewDirection=facingOrientation, angularWidth=code_block_4)
bySpaceLatticeAndViewCone = Visibility.ViewField.BySpaceLatticeAndViewCone(spaceLattice=byBoundingBoxAndLines, viewCone=byViewPointAndViewDirection)
byViewField = Visibility.VisibilityGrid.ByViewField(viewField=bySpaceLatticeAndViewCone)

# group: This visualizes the results
# note: Custom Package: SpaceAnalysis
surface = Visibility.VisibilityGrid.Surface(visibilityGrid=byViewField)
color_palette = ColorPalette({R: 112, G: 128, B: 144, A: 255})
color_palette_2 = ColorPalette({R: 255, G: 255, B: 0, A: 255})
list_create_2 = List.Create(item0=color_palette, item1=color_palette_2)
code_block_5 = CodeBlock { 0..1; }
values = Visibility.VisibilityGrid.Values(visibilityGrid=byViewField)
color_range = ColorRange(colors=list_create_2, indices=code_block_5, value=values)
bySurfaceColors = Modifiers.GeometryColor.BySurfaceColors(surface=surface, colors=color_range)
