# Dynamo graph CreateWPFWindow.dyn (Dynamo 2.16.1.2727)

code_block = CodeBlock { "Test Window"; }
code_block_2 = CodeBlock { "Hello there!"; }
python_script = Python(IN[0]=code_block, IN[1]=code_block_2)  # IronPython2; unwired: IN[2]
# ---------- python_script.python (66 lines) ----------
import clr	
import sys
import System
sys.path.append(r'C:\Program Files (x86)\IronPython 2.7\Lib')
sys.path.append(r'C:\Program Files (x86)\IronPython 2.7\DLLs')

try:
	clr.AddReference("IronPython.Wpf")
	clr.AddReference('System.Core')
	clr.AddReference('System.Xml')
	clr.AddReference('PresentationCore')
	clr.AddReference('PresentationFramework')
	clr.AddReferenceByPartialName("WindowsBase")
except IOError:
	raise
	
from System.IO import StringReader
from System.Windows.Markup import XamlReader, XamlWriter
from System.Windows import Window, Application

try:
	import wpf
	import time
except ImportError:
	raise
class CreateWindow(Window):
	LAYOUT = '''
	<Window 
             xmlns="http://schemas.microsoft.com/winfx/2006/xaml/presentation"
             xmlns:x="http://schemas.microsoft.com/winfx/2006/xaml"
             xmlns:mc="http://schemas.openxmlformats.org/markup-compatibility/2006" 
             xmlns:d="http://schemas.microsoft.com/expression/blend/2008" 
             mc:Ignorable="d" 
             Height="140" Width="400"
             WindowStartupLocation="CenterScreen">
    <Grid>
        <Grid.RowDefinitions>
            <RowDefinition Height="*"/>
            <RowDefinition Height="36"/>
        </Grid.RowDefinitions>

<TextBox Name="MessageBox" Grid.Row="0" Margin="8" Text="A" TextWrapping="Wrap" Foreground="Red" BorderBrush="{x:Null}" IsHitTestVisible="False"/>

<!--the buttons section-->
        <Grid Grid.Row="1" Background="LightGray">
            <Grid.ColumnDefinitions>
                <ColumnDefinition Width="*"/>
                <ColumnDefinition Width="*"/>
                <ColumnDefinition Width="*"/>
            </Grid.ColumnDefinitions>
            <Button Grid.Column="2" Content="Close" Margin="8 4" IsCancel="True"/>
        </Grid>
        
    </Grid>
</Window>
	'''
	
	def __init__(self):
		self.ui = wpf.LoadComponent(self, StringReader(CreateWindow.LAYOUT))
		self.Title = IN[0]
		self.MessageBox.Text = IN[1]
				
pb = CreateWindow()
pb.ShowDialog()

OUT = pb.MessageBox.Text
# ----------------------------------------
