# Dynamo graph LowerLeftCornerGroup.dyn (Dynamo 2.6.1.8786)
# packages: Rhythm 2021.1.1

select_model_elements = DSModelElementsSelection()  # 7 picked in the model
boundingBox = Element.BoundingBox(element=select_model_elements)
toCuboid = BoundingBox.ToCuboid(boundingBox=boundingBox)
byGeometry = BoundingBox.ByGeometry(geom=toCuboid)
minPoint = BoundingBox.MinPoint(boundingBox=byGeometry)
ʳʰʸᵗʰᵐ_group_byelementsandorigin = Rhythm.Revit.Elements.Group.ByElementsAndOrigin(elements=select_model_elements, origin=minPoint)
