# Dynamo graph PopularCommands.dyn (Dynamo 2.6.0.8481)
# packages: Journalysis for Dynamo 2.x 2.3.1, NodeModelCharts 2.0.2

# group: Read all journals from directory
string = StringInput("C:\Users\johnpierson\AppData\Local\Autodesk\Revit\Autodesk Revit 2021\Journals")
directory_from_path = DirectoryObject(path=string)
string_2 = StringInput("*.txt")
getDirectoryContents = FileSystem.GetDirectoryContents(directory=directory_from_path, searchString=string_2)
byPath = Custom[Journal.ByPath](path=getDirectoryContents.files)  # package Journalysis for Dynamo 2.x; Creates a queryable object from the contents of a Revit journal file

# group: Get all journal commands from the given journals
code_block = CodeBlock { "JournalCommand"; }
linesByType = Custom[Journal.LinesByType](journal=byPath, journalLineType=code_block)  # package Journalysis for Dynamo 2.x; Retrieves all JournalLines of a given type from a given journal

# group: clean up the data
code_block_2 = CodeBlock { false; }
clean = List.Clean(list=linesByType, preserveIndices=code_block_2)
flatten = List.Flatten(list=clean)

# group: Read the command for the description and clean the data
description = Custom[JournalCommand.Description](journalCommand=flatten)  # package Journalysis for Dynamo 2.x; Returns the description of a JournalCommand line
code_block_3 = CodeBlock { ""; }
eq = description == code_block_3
filterByBoolMask = List.FilterByBoolMask(list=description, mask=eq)
groupByKey = List.GroupByKey(list=filterByBoolMask.out, keys=filterByBoolMask.out)
count = List.Count(list=groupByKey.groups@L2)

code_block_4 = CodeBlock(things=groupByKey.unique_keys) { 0..1..#List.Count(things); }
color_range = ColorRange(value=code_block_4)  # unwired: colors, indices
pie_chart = PieChartNodeModel(labels=groupByKey.unique_keys, values=count, colors=color_range, Labels=["Display Profile Dialog", "Model Browser", "Quit the application; prompts to save projects", "Create a new project", "Launch Dynamo", "Manage, create, or modify shared parameters", "Open an existing project", "Collaborate", "Create a railing", "Cancel the current operation"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], Values=[95, 4, 61, 30, 10, 2, 15, 2, 1, 254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], Colors=["#FFFF6464", "#FFFF6A60", "#FFFF6F5D", "#FFFF7559", "#FFFF7B55", "#FFFF8151", "#FFFF864E", "#FFFF8C4A", "#FFFF9246", "#FFFF9843"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])
