# Dynamo graph generateFloorOnGroup.dyn (Dynamo 2.6.1.8786)
# packages: Clockwork for Dynamo 2.x 2.3.0, spring nodes 203.2.0, Rhythm 2021.1.1

# group: Input
# note: For selection and whatnot

# group: Control
# note: For sliders and other options

# group: To Revit
# note: For changes made to Revit

# group: Annotation
# note: For notes and titles

# group: Info
# note: For general Information

# group: Other
# note: For general other needs

# group: Background
# note: For workflow

# group: License
# note: GNU License
# This program is free software: you can redistribute it and/or modify it under the terms of the GNU General Public License as published by the Free Software Foundation, either version 3 of the License, or (at your option) any later version.
# This program is distributed in the hope that it will be useful, but WITHOUT ANY WARRANTY; without even the implied warranty of MERCHANTABILITY or FITNESS FOR A PARTICULAR PURPOSE. See the GNU General Public License for more details.
# You should have received a copy of the GNU General Public License along with this program. If not, see http://www.gnu.org/licenses/

# group: Inputs for Dynamo Player
select_model_group = DSModelElementSelection()  # 1 picked in the model; graph input
outer_buffer = IntegerSlider(5, range=1..100 step 1)  # graph input
floor_type_to_use = FloorTypes("FINISH FLOOR - CPT1")  # graph input

# group: Just use the group level and plane along the way
# note: Custom Package: Clockwork v.2.3.0
level = Custom[Element.Level](element=select_model_group)  # package Clockwork for Dynamo 2.x; Gets an element's level
plane = Custom[Level.Plane](level=level)  # package Clockwork for Dynamo 2.x; Retrieves the plane of a given level

# group: Extract group bounding box
boundingBox = Element.BoundingBox(element=select_model_group)
toCuboid = BoundingBox.ToCuboid(boundingBox=boundingBox)

# group: Generate a temporary room boundary
intersect = Geometry.Intersect(geometry=toCuboid, other=plane)
perimeterCurves = Surface.PerimeterCurves(surface=intersect)
byJoinedCurves = PolyCurve.ByJoinedCurves(curves=perimeterCurves)
offset = Curve.Offset(curve=byJoinedCurves, distance=outer_buffer)

# group: Build a room location "in between" the demising walls and our offset boundary
pointAtParameter = Curve.PointAtParameter(curve=byJoinedCurves)
pointAtParameter_2 = Curve.PointAtParameter(curve=offset)
byStartPointEndPoint = Line.ByStartPointEndPoint(startPoint=pointAtParameter, endPoint=pointAtParameter_2)
code_block = CodeBlock { 0.5; }
pointAtParameter_3 = Curve.PointAtParameter(curve=byStartPointEndPoint, param=code_block)

# group: Place Temp Room and Get Inner Curves
byLocation = Room.ByLocation(level=level, location=pointAtParameter_3)

# group: Build Room Separators
explode = Geometry.Explode(geometry=offset)
flatten = List.Flatten(list=explode)
byPlane = SketchPlane.ByPlane(plane=plane)
# note: Custom Package: spring nodes v.203.2.0
ꟿ_document_activeview = Custom[ꟿ Document.ActiveView](refresh=select_model_group)  # package spring nodes; Selects the current document's active view. Supports more view types than the built-in option. Will be depreciated once the bult in node works with all plan types.
# note: Custom Package: Clockwork v.2.3.0
fromCurve = Custom[RoomSeparator.FromCurve](curve=flatten, sketchPlane=byPlane, view=ꟿ_document_activeview)  # package Clockwork for Dynamo 2.x; Creates room separation lines from geometry curves.

# group: To be deleted
list_create = List.Create(item0=byLocation, item1=fromCurve)
flatten_2 = List.Flatten(list=list_create)

end = Revit.Transaction.Transaction.End(input=byLocation)

# group (continued): Place Temp Room and Get Inner Curves
centerBoundary = Room.CenterBoundary(room=end)
lastItem = List.LastItem(list=centerBoundary@L3)

# group: Build a floor "wrapping" the core center of the demising walls
byOutlineTypeAndLevel = Floor.ByOutlineTypeAndLevel(outlineCurves=lastItem, floorType=floor_type_to_use, level=level)

# group: Serialize the UV data for group location
# note: Custom Package: Rhythm v.2021.1.1
ʳʰʸᵗʰᵐ_hostobject_topsurface = Rhythm.Revit.Elements.HostObject.TopSurface(hostObject=byOutlineTypeAndLevel)
getLocation = Element.GetLocation(element=select_model_group)
UVParameterAtPoint = Surface.UVParameterAtPoint(surface=ʳʰʸᵗʰᵐ_hostobject_topsurface, point=getLocation)
flatten_3 = List.Flatten(list=UVParameterAtPoint)
U = UV.U(uV=flatten_3)
V = UV.V(uV=flatten_3)
code_block_2 = CodeBlock(u=U, v=V) { u + "$" + v; }

# group: Serialize the OG group name and UV location to the comments
code_block_3 = CodeBlock { "Comments"; }
name = Element.Name(element=select_model_group)
code_block_4 = CodeBlock(groupName=name, uvValue=code_block_2) { groupName + "," + uvValue; }
setParameterByName = Element.SetParameterByName(element=byOutlineTypeAndLevel, parameterName=code_block_3, value=code_block_4)

# group: Delete the temporary geometry
# note: Custom Package: Clockwork v.2.3.0
passthrough = Custom[Passthrough](passThrough=flatten_2, waitFor=setParameterByName)  # package Clockwork for Dynamo 2.x; Forces a sequential order of execution. The node wired into the output of the Passthrough node will be executed *after* the node wired into the waitFor input (e.g. important for some Revit operations). The value of the passThrough input will be passed on to the node wired into the output port of the Passthrough node.
code_block_5 = CodeBlock { true; }
# note: Custom Package: spring nodes v.203.2.0
ꟿ_document_deleteelements = Custom[ꟿ Document.DeleteElements](element=passthrough, confirm=code_block_5)  # package spring nodes; Attempts to delete the input list of elements from the active Revit document.The node returns the number of successfully deleted elements and their Ids as a string. Carefully observe the deleted elements count. It may be greater than the input list because hosted elements or tags will be deleted as well. If an element in the list can not be deleted (for example last revision or last view), the whole list will fail to be deleted.

# note: Custom Package: spring nodes v.203.2.0
ꟿ_selectinrevit = Custom[ꟿ SelectInRevit](element=setParameterByName)  # package spring nodes; Selects the input elements inside the Revit UI.
