# Dynamo graph generateGroupOnFloor.dyn "placeGroup" (Dynamo 2.6.1.8786)
# packages: Rhythm 2021.1.1

# group: User Inputs
select_floor = DSModelElementSelection()  # 1 picked in the model; graph input

# group: Deconstruct the serialized data
code_block = CodeBlock { "Comments"; }
getParameterValueByName = Element.GetParameterValueByName(element=select_floor, parameterName=code_block)
code_block_2 = CodeBlock { ","; "$"; }
split = String.Split(str=getParameterValueByName, separator0=code_block_2.out0, separator1=code_block_2.out1)
code_block_3 = CodeBlock(list=split) { groupType = list[0]; u = DSCore.String.ToNumber(list[1]); v = DSCore.String.ToNumber(list[2]); }

# group: Build our placement location
ʳʰʸᵗʰᵐ_hostobject_topsurface = Rhythm.Revit.Elements.HostObject.TopSurface(hostObject=select_floor)
flatten = List.Flatten(list=ʳʰʸᵗʰᵐ_hostobject_topsurface)
pointAtParameter = Surface.PointAtParameter(surface=flatten, u=code_block_3.u, v=code_block_3.v)

# group: Build a unique lookup dictionary of group types
converted_from_dropdown_with = CodeBlock { DSCore.Types.FindTypeByNameInAssembly("GroupType", "RevitAPI"); }  # "Converted from Dropdown with Monocle™"
all_elements_of_type = ElementsOfType(element_type=converted_from_dropdown_with)
name = Element.Name(element=all_elements_of_type)
groupByKey = List.GroupByKey(list=all_elements_of_type, keys=name)
firstItem = List.FirstItem(list=groupByKey.groups@L2)
byKeysValues = DesignScript.Builtin.Dictionary.ByKeysValues(keys=groupByKey.unique_keys, values=firstItem)
valueAtKey = DesignScript.Builtin.Dictionary.ValueAtKey(dictionary=byKeysValues, key=code_block_3.groupType)

# group: Place Group
placeInstance = Group.PlaceInstance(location=pointAtParameter, groupType=valueAtKey)
