# Dynamo graph calcPoints.dyn (Dynamo 2.6.1.8786)

# group: License
# note: GNU License
# This program is free software: you can redistribute it and/or modify it under the terms of the GNU General Public License as published by the Free Software Foundation, either version 3 of the License, or (at your option) any later version.
# This program is distributed in the hope that it will be useful, but WITHOUT ANY WARRANTY; without even the implied warranty of MERCHANTABILITY or FITNESS FOR A PARTICULAR PURPOSE. See the GNU General Public License for more details.
# You should have received a copy of the GNU General Public License along with this program. If not, see http://www.gnu.org/licenses/

# group: Get families from directory
directory_of_families = StringInput("C:\Users\johnpierson\Desktop\SampleFamilies\13")
directory_from_path = DirectoryObject(path=directory_of_families)
code_block = CodeBlock { "*.rfa"; }
getDirectoryContents = FileSystem.GetDirectoryContents(directory=directory_from_path, searchString=code_block)

py_openfamilyinbackground = Python(IN[0]=getDirectoryContents.files)  # ".py - openFamilyInBackground-ToggleCalculationPoint"
# ---------- py_openfamilyinbackground.python (32 lines) ----------
import clr
clr.AddReference('RevitAPI')
from Autodesk.Revit.DB import *
from System.Collections.Generic import *

clr.AddReference("RevitServices")
import RevitServices
from RevitServices.Persistence import DocumentManager
from RevitServices.Transactions import TransactionManager

doc = DocumentManager.Instance.CurrentDBDocument
app = DocumentManager.Instance.CurrentUIApplication.Application

def TurnOnRoomCalcPoint(path):
	doc = app.OpenDocumentFile(path)		
	fam = doc.OwnerFamily
	TransactionManager.Instance.ForceCloseTransaction()
	t = Transaction(doc,"Toggling Room Calc")
	t.Start()
	fam.get_Parameter(BuiltInParameter.ROOM_CALCULATION_POINT).Set(1)
	t.Commit()
	try:
		doc.Close(True)
		return path + "| Success";
	except:
		doc.Close(False)
		return path + "| Fail"

paths = UnwrapElement(IN[0])

if isinstance(IN[0], list): OUT = [TurnOnRoomCalcPoint(x) for x in paths]
else: OUT = TurnOnRoomCalcPoint(paths)
# ----------------------------------------
