# Dynamo graph collectDimensionTypesGrouped.dyn (Dynamo 2.6.0.8481)

code_block = CodeBlock { DSCore.Types.FindTypeByNameInAssembly("DimensionType", "RevitAPI"); }
all_elements_of_type = ElementsOfType(element_type=code_block)
python_script = Python(IN[0]=all_elements_of_type)
# ---------- python_script.python (21 lines) ----------
import clr

clr.AddReference('RevitAPI')
from Autodesk.Revit.DB import *

clr.AddReference('RevitServices')
import RevitServices
from RevitServices.Persistence import DocumentManager
from RevitServices.Transactions import TransactionManager

doc = DocumentManager.Instance.CurrentDBDocument
uidoc=DocumentManager.Instance.CurrentUIApplication.ActiveUIDocument

# tthe name to find
dimensionTypes = IN[0]

dimensionsByType = []
for d in dimensionTypes:
	dimensionsByType.append(filter(lambda v: v.DimensionType.Id.IntegerValue == d.Id,FilteredElementCollector(doc).OfClass(Dimension)))

OUT = dimensionsByType
# ----------------------------------------
