# Dynamo graph heatMapFloorHeights.dyn (Dynamo 2.6.1.8786)
# packages: Rhythm 2020.9.8, spring nodes 203.2.0

# group: Non-Shape Edited rendering surface
select_face = DSFaceSelection()  # 1 picked in the model

# group: Select Shape-Edited Floor
select_model_element = DSModelElementSelection()  # 1 picked in the model

# group: Obtain the points and their z values
# note: Custom Package: Rhythm v.2020.9.8
ʳʰʸᵗʰᵐ_hostobject_topsurface = Rhythm.Revit.Elements.HostObject.TopSurface(hostObject=select_model_element)
vertices = Topology.Vertices(topology=ʳʰʸᵗʰᵐ_hostobject_topsurface)
pointGeometry = Vertex.PointGeometry(vertex=vertices)
flatten = List.Flatten(list=pointGeometry)

# group: Obtain the render surface's z value
pointAtParameter = Surface.PointAtParameter(surface=select_face)
Z = Point.Z(point=pointAtParameter)

# group: reconstruct the shape edited points to be in-plane to the render surface
X = Point.X(point=flatten)
Y = Point.Y(point=flatten)
byCoordinates = Point.ByCoordinates(x=X, y=Y, z=Z, lacing=Longest)
Z_2 = Point.Z(point=flatten)

# group: get uv parameters for rendering
UVParameterAtPoint = Surface.UVParameterAtPoint(surface=select_face, point=byCoordinates, lacing=Longest)

# group: Generate our preview
# note: Custom Package: spring nodes v.203.2.0
ꟿ_document_activeview = Custom[ꟿ Document.ActiveView]()  # package spring nodes; Selects the current document's active view. Supports more view types than the built-in option. Will be depreciated once the bult in node works with all plan types.
code_block = CodeBlock()
# ---------- code_block.designscript (2 lines) ----------
DSCore.Types.
FindTypeByNameInAssembly("Length", "DynamoUnits");
# ----------------------------------------
byViewFacePointsAndValues = Revit.AnalysisDisplay.FaceAnalysisDisplay.ByViewFacePointsAndValues(view=ꟿ_document_activeview, surface=select_face, sampleLocations=UVParameterAtPoint, samples=Z_2, unitType=code_block)
