# Dynamo graph interiorElevationNamer2k1.dyn (Dynamo 2.10.1.3976)
# packages: Rhythm 2021.1.1, Clockwork for Dynamo 2.x 2.3.0, archi-lab.net 2022.210.2522, spring nodes 204.1.0

# group: Set the new names
# note: Custom Package: archilab v.2021.25.4

# group: Input
# note: For selection and whatnot

# group: Control
# note: For sliders and other options

# group: To Revit
# note: For changes made to Revit

# group: Annotation
# note: For notes and titles

# group: Info
# note: For general Information

# group: Other
# note: For general other needs

# group: Background
# note: For workflow

# group: License
# note: GNU License
# This program is free software: you can redistribute it and/or modify it under the terms of the GNU General Public License as published by the Free Software Foundation, either version 3 of the License, or (at your option) any later version.
# This program is distributed in the hope that it will be useful, but WITHOUT ANY WARRANTY; without even the implied warranty of MERCHANTABILITY or FITNESS FOR A PARTICULAR PURPOSE. See the GNU General Public License for more details.
# You should have received a copy of the GNU General Public License along with this program. If not, see http://www.gnu.org/licenses/

# group: Dependencies
# note: Packages Required
# Rhythm v.2021.1.1
# archilab v.2021.25.4
# Clockwork v.2.3.0

# group: Collect section views in current view (elevations are technically sections in the API)
ꟿ_document_activeview = Custom[ꟿ Document.ActiveView]()  # package spring nodes; Selects the current document's active view. Supports more view types than the built-in option. Will be depreciated once the bult in node works with all plan types.
# note: We use this methodology here as dropdowns are unreliable between revit versions
ᶜᵒⁿᵛᵉʳᵗᵉᵈ_ᶠʳᵒᵐ_ᴰʳᵒᵖᵈᵒʷⁿ_ʷᶦᵗʰ = CodeBlock { Category.ByName("Elevations"); }  # "ᶜᵒⁿᵛᵉʳᵗᵉᵈ ᶠʳᵒᵐ ᴰʳᵒᵖᵈᵒʷⁿ ʷᶦᵗʰ ᴹᵒⁿᵒᶜˡᵉ™"
ꟿ_collect_elementsinview = Custom[ꟿ Collect.ElementsInView](view=ꟿ_document_activeview, category=ᶜᵒⁿᵛᵉʳᵗᵉᵈ_ᶠʳᵒᵐ_ᴰʳᵒᵖᵈᵒʷⁿ_ʷᶦᵗʰ)  # package spring nodes; Selects all elements visible in the input view.

# group: Filter for views that are interior
elementType = Element.ElementType(element=ꟿ_collect_elementsinview)
name = Element.Name(element=elementType)
string_from_object = FromObject(obj=name)
code_block = CodeBlock { "interior"; true; }
contains = String.Contains(str=string_from_object, searchFor=code_block.out0, ignoreCase=code_block.out1)
filterByBoolMask = List.FilterByBoolMask(list=ꟿ_collect_elementsinview, mask=contains)

# group: Get the elevations that depend on that marker
# note: We use this methodology here as dropdowns are unreliable between revit versions
converted_from_dropdown_with = CodeBlock { Category.ByName("Views"); }  # "Converted from Dropdown with Monocle™"
# note: Custom Package: Rhythm v.2021.1.1
ʳʰʸᵗʰᵐ_elements = Rhythm.Revit.Elements.Elements.DependentElementsOfCategory(element=filterByBoolMask.in, category=converted_from_dropdown_with)

code_block_2 = CodeBlock(elevations=ʳʰʸᵗʰᵐ_elements) { elevations; }

# group: Since the markers _should_ be in the same room. We will just get the first sections
firstItem = List.FirstItem(list=ʳʰʸᵗʰᵐ_elements@L2)

# group: Get the room that corresponds to it
# note: Custom Package: Rhythm v.2021.1.1
ʳʰʸᵗʰᵐ_viewsection_locationpoint = Rhythm.Revit.Views.ViewSection.LocationPoint(view=firstItem)

X = Point.X(point=ʳʰʸᵗʰᵐ_viewsection_locationpoint)
Y = Point.Y(point=ʳʰʸᵗʰᵐ_viewsection_locationpoint)

# group: Get view level to reconstruct point
level = Custom[Element.Level](element=ꟿ_document_activeview)  # package Clockwork for Dynamo 2.x; Gets an element's level
elevation = Level.Elevation(level=level)
code_block_3 = CodeBlock()
# ---------- code_block_3.designscript (2 lines) ----------
//buffer
1;
# ----------------------------------------
add = elevation + code_block_3

byCoordinates = Point.ByCoordinates(x=X, y=Y, z=add)
getRoomAtPoint = archilab.Revit.Selection.Select.GetRoomAtPoint(point=byCoordinates)

# group (continued): Get the room that corresponds to it
# note: Custom Package: archilab v.2021.25.4
name_2 = Element.Name(element=getRoomAtPoint)

# group: Generate a letter list for the 4 sections (in our case it is 4)
count = List.Count(list=ʳʰʸᵗʰᵐ_elements@L2)
code_block_4 = CodeBlock { true; }
# note: Custom Package: Clockwork v.2.3.0
byNumber = Custom[AlphabeticalSequence.ByNumber](n=count, upperCase=code_block_4)  # package Clockwork for Dynamo 2.x; Creates a list of the first N letters of the alphabet (where 1 = A, 2 = B, ... , 27 = AA, 28 = AB etc.).

the_new_elevation_name = CodeBlock(roomName=name_2, elevationNumber=byNumber) { roomName + "-" + elevationNumber; }
setName = archilab.Revit.Views.Views.SetName(view=code_block_2, name=the_new_elevation_name)
