# Dynamo graph patchRoomBoundaries.dyn (Dynamo 2.12.0.5650)

# group: Collect rooms
categories = Categories("OST_Rooms")
all_elements_of_category = ElementsOfCategory(Category=categories)

# group: Get outermost boundary
# note: These boundaries have the extra lines
finishBoundary = Room.FinishBoundary(room=all_elements_of_category)
firstItem = List.FirstItem(list=finishBoundary@L3)

# group: Repatch as closed surface
byJoinedCurves = PolyCurve.ByJoinedCurves(curves=firstItem)
byPatch = Surface.ByPatch(closedCurve=byJoinedCurves)

# group: Perform intersection test on solids to get clean perimeters
boolean = BoolSelector(false)
thicken = Surface.Thicken(surface=byPatch, both_sides=boolean)
pointAtParameter = Surface.PointAtParameter(surface=byPatch)
byOriginNormal = Plane.ByOriginNormal(origin=pointAtParameter)
intersect = Geometry.Intersect(geometry=thicken, other=byOriginNormal, lacing=Shortest)

# group: Perimeter curves (simplified) - Each sublist is a room
flatten = List.Flatten(list=intersect)
perimeterCurves = Surface.PerimeterCurves(surface=flatten)
