# Dynamo graph revitRailingPostStuff.dyn (Dynamo 2.5.2.7915)

# group: Select single railing instance (Also converts to railing type)
select_model_element = DSModelElementSelection()  # 1 picked in the model
elementType = Element.ElementType(element=select_model_element)

# group: Reports the post (if you don't want to change)
python_getposttypes = Python(IN[0]=elementType)
# ---------- python_getposttypes.python (40 lines) ----------
import clr

clr.AddReference('RevitAPI')
from Autodesk.Revit.DB import *
from Autodesk.Revit.DB.Structure import *

clr.AddReference('RevitAPIUI')
from Autodesk.Revit.UI import *

clr.AddReference('System')
from System.Collections.Generic import List

clr.AddReference('RevitNodes')
import Revit
clr.ImportExtensions(Revit.GeometryConversion)
clr.ImportExtensions(Revit.Elements)

clr.AddReference('RevitServices')
import RevitServices
from RevitServices.Persistence import DocumentManager
from RevitServices.Transactions import TransactionManager

doc = DocumentManager.Instance.CurrentDBDocument
uidoc=DocumentManager.Instance.CurrentUIApplication.ActiveUIDocument

#Preparing input from dynamo to revit
element = UnwrapElement(IN[0])

balusterPlacement = element.BalusterPlacement
postPattern = balusterPlacement.PostPattern
startPost = postPattern.StartPost 
cornerPost = postPattern.CornerPost
endPost = postPattern.EndPost 

#Do some action in a Transaction
TransactionManager.Instance.EnsureInTransaction(doc)

TransactionManager.Instance.TransactionTaskDone()

OUT = doc.GetElement(startPost.BalusterFamilyId),doc.GetElement(cornerPost.BalusterFamilyId),doc.GetElement(endPost.BalusterFamilyId)
# ----------------------------------------

# group: Select baluster type and which post you want to tweak
new_baluster_type = FamilyTypes("M_Baluster - Round:25mm")
start_0_corner_1_end_2 = IntegerSlider(2, range=0..2 step 1)

# group: Changes the post in a Revit transaction
python_setposttype = Python(IN[0]=elementType, IN[1]=new_baluster_type, IN[2]=start_0_corner_1_end_2)
# ---------- python_setposttype.python (53 lines) ----------
import clr

clr.AddReference('RevitAPI')
from Autodesk.Revit.DB import *
from Autodesk.Revit.DB.Structure import *

clr.AddReference('RevitAPIUI')
from Autodesk.Revit.UI import *

clr.AddReference('System')
from System.Collections.Generic import List

clr.AddReference('RevitNodes')
import Revit
clr.ImportExtensions(Revit.GeometryConversion)
clr.ImportExtensions(Revit.Elements)

clr.AddReference('RevitServices')
import RevitServices
from RevitServices.Persistence import DocumentManager
from RevitServices.Transactions import TransactionManager

doc = DocumentManager.Instance.CurrentDBDocument
uidoc=DocumentManager.Instance.CurrentUIApplication.ActiveUIDocument

def setPost(i,postPattern):
        switcher={
                0:postPattern.StartPost,
                1:postPattern.CornerPost,
                2: postPattern.EndPost
             }
	return switcher.get(i,postPattern.StartPost)

#Preparing input from dynamo to revit
railingType = UnwrapElement(IN[0])

balusterType = IN[1]
#choice of start[1], corner[2], or end[3]
choice = IN[2]

balusterPlacement = railingType.BalusterPlacement
postPattern = balusterPlacement.PostPattern

#Set the new post type
TransactionManager.Instance.EnsureInTransaction(doc)
try:
	setPost(choice,postPattern).BalusterFamilyId = ElementId(balusterType.Id)
	result = "Success!"
except:
	result = "Failed, cannot change baluster type to selected type"
TransactionManager.Instance.TransactionTaskDone()

OUT = result
# ----------------------------------------
