# Dynamo graph soundStuff.dyn (Dynamo 2.10.0.3455)
# packages: SpaceAnalysis 0.3.3

code_block = CodeBlock { 500; 273; }
byWidthLength = Rectangle.ByWidthLength(width=code_block.out0, length=code_block.out1)
byPatch = Surface.ByPatch(closedCurve=byWidthLength)
file_path = Filename("C:\Users\johnpierson\Desktop\maxell.jpg")
file_from_path = FileObject(path=file_path)
readFromFile = Image.ReadFromFile(file=file_from_path)
code_block_2 = CodeBlock { 125; 68; }
pixels = Image.Pixels(image=readFromFile, xSamples=code_block_2.out0, ySamples=code_block_2.out1)
reverse = List.Reverse(list=pixels)
transpose = List.Transpose(lists=reverse)
bySurfaceColors = Modifiers.GeometryColor.BySurfaceColors(surface=byPatch, colors=transpose)
edges = Core.SpaceLattice.Edges()  # unwired: spaceLattice
byGeometry = BoundingBox.ByGeometry(geom=byPatch)
code_block_3 = CodeBlock(u=code_block_2.out0, v=code_block_2.out1) { 0..1..#u; 0..1..#v; }
pointAtParameter = Surface.PointAtParameter(surface=byPatch, u=code_block_3.out0, v=code_block_3.out1, lacing=CrossProduct)
brightness = Color.Brightness(c=transpose)
code_block_4 = CodeBlock { 0.3; }
gt = brightness > code_block_4
filterByBoolMask = List.FilterByBoolMask(list=pointAtParameter, mask=gt)
byPoints = PolyCurve.ByPoints(points=filterByBoolMask.out)
code_block_5 = CodeBlock { false; }
clean = List.Clean(list=byPoints, preserveIndices=code_block_5)
explode = Geometry.Explode(geometry=clean)
flatten = List.Flatten(list=explode)
code_block_6 = CodeBlock { 2; }
byBoundingBoxAndLines = Core.SpaceLattice.ByBoundingBoxAndLines(boundingBox=byGeometry, barriers=flatten, resolution=code_block_6)
points = Core.SpaceLattice.Points(spaceLattice=byBoundingBoxAndLines)
number_slider = DoubleSlider(-154.924, range=-154.924..100 step 0.1)
byCoordinates = Point.ByCoordinates(x=number_slider)
bySoundPoints = Acoustics.SoundSystem.BySoundPoints(soundPoints=byCoordinates)
bySpaceLatticeAndSoundSystem = Acoustics.SoundField.BySpaceLatticeAndSoundSystem(spaceLattice=byBoundingBoxAndLines, soundSystem=bySoundPoints)
bySoundField = Acoustics.AudibilityGrid.BySoundField(soundField=bySpaceLatticeAndSoundSystem)
valueAtPoint = Acoustics.AudibilityGrid.ValueAtPoint(audibilityGrid=bySoundField, point=points)
surface = Acoustics.AudibilityGrid.Surface(audibilityGrid=bySoundField)

# group: Display Values of the AudibilityGrid
code_block_7 = CodeBlock()
# ---------- code_block_7.designscript (10 lines) ----------
a = 255;
DSCore.Color.ByARGB(0,225, 242, 247);
DSCore.Color.ByARGB(a,206, 232, 229);
DSCore.Color.ByARGB(a,177, 210, 211);
DSCore.Color.ByARGB(a,140, 192, 198);
DSCore.Color.ByARGB(a,131, 186, 211);
DSCore.Color.ByARGB(a,152, 146, 237);
DSCore.Color.ByARGB(a,186, 132, 245);
DSCore.Color.ByARGB(a,217, 100, 241);
DSCore.Color.ByARGB(a,255, 119, 226);
# ----------------------------------------
list_create = List.Create(item0=code_block_7.out1, item1=code_block_7.out2, item2=code_block_7.out3, item3=code_block_7.out4, item4=code_block_7.out5, item5=code_block_7.out6, item6=code_block_7.out7, item7=code_block_7.out8, item8=code_block_7.out9)
code_block_8 = CodeBlock { 0..1..#9; }
code_block_9 = CodeBlock { 0.01; 1; }
code_block_10 = CodeBlock(inputValues=valueAtPoint, surface=surface) { inputValues; surface; }
map = Math.Map(rangeMin=code_block_9.out0, rangeMax=code_block_9.out1, inputValue=code_block_10.inputValues)
color_range = ColorRange(colors=list_create, indices=code_block_8, value=map)

byGeometryColor = Modifiers.GeometryColor.ByGeometryColor(geometry=points, color=color_range)
