# Dynamo graph filter.dyn (Dynamo 2.16.1.2727)

categories = Categories("OST_Rooms")
all_elements_of_category = ElementsOfCategory(Category=categories)
area = Room.Area(room=all_elements_of_category)
code_block = CodeBlock { 0; }
gt = area > code_block
filterByBoolMask = List.FilterByBoolMask(list=all_elements_of_category, mask=gt)
rooms_that_are_placed_and = Watch(filterByBoolMask.in)  # "rooms that are placed and bounded"
name = Room.Name(room=rooms_that_are_placed_and)
code_block_2 = CodeBlock { ""; }
ne = name != code_block_2
filterByBoolMask_2 = List.FilterByBoolMask(list=rooms_that_are_placed_and, mask=ne)
rooms_with_a_name = Watch(filterByBoolMask_2.in)
number = Room.Number(room=rooms_with_a_name)
ne_2 = number != code_block_2
filterByBoolMask_3 = List.FilterByBoolMask(list=rooms_with_a_name, mask=ne_2)
rooms_that_are_placed_bounded = Watch(filterByBoolMask_3.in)  # "rooms that are placed, bounded and have a name and number"
